# Requirement set req_functional (R2023b)

## 1 [ReqFun_1] Control speed
The pendulum needs to be controlled to the target within 1 second.

## 2 [ReqFun_2] Control robustness
The control system needs to be capable of controlling 2 types of pendulums without any change in the control parameters:
- 20 cm long
- 30 cm long
The mass of the bulb is 0.1 kg.

## 3 [ReqFun_3] Power consumption
The motor driver shall not require more than 120 W in a steady state.

## 4 [ReqFun_4] Avoid control command saturation
The control command shall not get saturated.