test file "test_req"

suite "Test Requirements Suite for the Pendulum Controller System"
  description: This test suite serves to verify the requirements of the pendulum controller system.

  case "Test Pendulum 1" [simulation]
    model arch_logical, harness arch_logical_Harness_ReqTest
    parameter set "Parameter Set 1": pendulum_type = PendulumTypes.Pendulum_1, obstacle_enable = ObstacleMode.Off  % model workspace
    post-load callback:
      sltest.harness.open(sltest_sut, sltest_bdroot);
    cleanup callback:
      run_mech_explorer(PendulumTypes.Pendulum_1, ObstacleMode.Off, './cache/voltage_1.mat');

  case "Test Pendulum 2" [simulation]
    model arch_logical, harness arch_logical_Harness_ReqTest
    parameter set "Parameter Set 1": pendulum_type = PendulumTypes.Pendulum_2, obstacle_enable = ObstacleMode.Off  % model workspace
    post-load callback:
      sltest.harness.open(sltest_sut, sltest_bdroot);
    cleanup callback:
      run_mech_explorer(PendulumTypes.Pendulum_2, ObstacleMode.Off, './cache/voltage_2.mat');

  case "Test Safety" [simulation] (disabled)
    model arch_logical, harness arch_logical_Harness_ConstantVelocity
    parameter set "Parameter Set 1": obstacle_enable = ObstacleMode.On, pendulum_type = PendulumTypes.Pendulum_1  % model workspace
    post-load callback:
      sltest.harness.open(sltest_sut, sltest_bdroot);
    cleanup callback:
      run_mech_explorer(PendulumTypes.Pendulum_1, ObstacleMode.On, './cache/voltage_3.mat');
    assessment "Safety Assessment": At any point of time, if contact_force > 0 becomes true then, with a delay between 0.9 and 1, contact_force < 1 must be true
      contact_force: signal arch_logical_Harness_ConstantVelocity/arch_logical|arch_logical/Obstacle/Obstacle/PS-Simulink Converter, port 1